# Grasshopper definition waterdrop_route_Grasshopper_full.gh (Grasshopper 1.0.7)

brep = Brep([<brep referenced from the Rhino model> x63])
mesh = MeshBrep(
    Brep=brep,
    Settings={GridMaxCount=0, GridMinCount=16, JaggedSeams=False, MaxEdgeLength=0, MinEdgeLength=0.0001, MinTolerance=0, Refine=True, RefineAngle=0, RelativeTolerance=0.65, SimplePlanes=True, Tolerance=0})
mjoin = MeshJoin(Meshes=mesh)
facen = FaceNormals(Mesh=mjoin)  # -> Centers, Normals
brep_2 = Brep(<brep referenced from the Rhino model>)
pt = Point([<point referenced from the Rhino model> x12])
python = GhPythonScript(
    start_points=pt,
    object=mjoin,
    floor=brep_2,
    steps=Slider(10000, range=1..10000),
    step_size=Slider(0.378, range=0..2),
    sliding_angle="27",
    drop_angle="153",
    normals=facen.Normals)  # -> out, points, x_ax, routes, point; inputs start_points: list of Point3d, object: Mesh, floor: Surface, steps: Int32, normals: list of Vector3d
# ---------- python: Python ----------
__author__ = "IlmoK"
__version__ = "2022.07.06"

import rhinoscriptsyntax as rs
import ghpythonlib.components as ghc



x_ax = []
point = []
routes = []
neg_Z = ghc.VectorXYZ(0, 0, -1)[0]




def main():
    for p_start in start_points:
        points = []
        points.append(p_start)
        p = ghc.ProjectPoint(p_start, neg_Z, object)[0]
        points.append(p)

        for x in range(0, steps):
            try:
                angle, normal, X_axis = GetAngle(p, object, neg_Z)
                print angle
                if angle <= sliding_angle:
                    points.append(p)
                    break
                elif angle > sliding_angle and angle <= drop_angle:
                    p = ProjectAlongNormal(X_axis, p, normal, object, points)
                    if p.Z == points[-1].Z:
                        p = ProjectVertically(p, neg_Z, object)
                    points.append(p)
                elif angle > drop_angle:
                    p_start = p
                    p = ProjectVertically(p, neg_Z, object)
                    if p==None:
                        p = ProjectVertically(p_start, neg_Z, floor)
                        points.append(p)
                        break
                    points.append(p)
            except Exception as e:
                print e
        routes.append( ghc.PolyLine(points, False))



def ProjectAlongNormal(X_axis, p, normal, object, points):

    p = ghc.Move(p, (X_axis*step_size+normal*(-0.05)))[0]
    p = ghc.MeshClosestPoint(p, object)[0]
#    x = 0.1
#    #print p
#    while ghc.Distance(p,points[-1])<step_size:
#        p = ghc.Move(p, (X_axis*step_size+normal*(-0.05-x)+neg_Z*(x)))[0]
#        p = ghc.BrepClosestPoint(p, object)[0]
#        x += 0.1

    return p


def GetAngle(p, object, neg_Z):
    normal = normals[ghc.MeshClosestPoint(p, object)[1]]
    plane = ghc.PlaneNormal(p, normal)
    plane_aligned = ghc.AlignPlane(plane, neg_Z)[0]
    X_axis = ghc.DeconstructPlane(plane_aligned)[1]
    
    XY_plane = ghc.PlaneNormal(p, ghc.UnitZ(1))
    XY_plane_aligned = ghc.AlignPlane(XY_plane, X_axis)[0]
    XY_X_axis = ghc.DeconstructPlane(XY_plane_aligned)[1]
    angle = ghc.Degrees(ghc.Angle(X_axis, XY_X_axis)[0])
    angle = AngleCorrection( angle, normal)
    print angle
    return angle, normal, X_axis


def ProjectVertically(p, neg_Z, object_dc):
    p = ghc.Move(p, neg_Z*0.08)[0]
    p = ghc.ProjectPoint(p, neg_Z, object_dc)[0]
    return p


def AngleCorrection(angle, normal):

    Z_value = ghc.DeconstructVector(normal)[2]
    if Z_value < 0:
        return 180 - angle
    else:
        return angle


if __name__ == "__main__":
    main()
# ---------- end python ----------
divide = DivideCurve(Curve=python.routes, Count="100", Kinks=False)  # -> Points, Tangents, Parameters
